# Grasshopper definition geoJson parser-Building Lot Info.gh (Grasshopper 1.0.7)

number_slider = Slider(275, range=0..1000)
panel = Panel(" Inputs")
path = FilePath("C:\Users\eertugrul\Downloads\lotGeometries.geojson")
c_script = CSharpScript(FilePath=path, Reference="C:\Program Files\ShapeDiver\ShapeDiverGhPlugins\Newtonsoft.Json.dll")  # -> out, PL, Zone, Block, Lot, Address, LandUse, LotArea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; inputs FilePath: String
# ---------- c_script: C# usings ----------
using Newtonsoft.Json;
using Newtonsoft.Json.Linq;
using System.IO;
# ---------- c_script: C# ----------
    List<Polyline> polylines = new List<Polyline>();
    List<string> zoneDist1Values = new List<string>();
    List<string> blockValues = new List<string>();
    List<string> lotValues = new List<string>();
    List<string> addressValues = new List<string>();
    List<string> landUseValues = new List<string>();
    List<string> lotAreaValues = new List<string>();
    List<string> lotFrontValues = new List<string>();
    List<string> lotDepthValues = new List<string>();
    List<string> builtFARValues = new List<string>();

    try
    {
      // Read the GeoJSON file
      string geoJsonString = File.ReadAllText(FilePath);

      // Parse the GeoJSON using Newtonsoft.Json
      JObject geoJson = JObject.Parse(geoJsonString);
      JArray features = (JArray) geoJson["features"];

      foreach (JObject feature in features)
      {
        string geometryType = feature["geometry"]["type"].ToString();

        // Retrieve ZoneDist1 from properties if it exists
        string zoneDist1;
        zoneDist1 = feature["properties"]["ZoneDist1"].ToString() ?? "N/A";
        zoneDist1Values.Add(zoneDist1);

        string block;
        block = feature["properties"]["Block"].ToString() ?? "N/A";
        blockValues.Add(block);

        string lot;
        lot = feature["properties"]["Lot"].ToString() ?? "N/A";
        lotValues.Add(lot);

        string address;
        address = feature["properties"]["Address"].ToString() ?? "N/A";
        addressValues.Add(address);

        string landUse;
        landUse = feature["properties"]["LandUse"].ToString() ?? "N/A";
        landUseValues.Add(landUse);

        string lotArea;
        lotArea = feature["properties"]["LotArea"].ToString() ?? "N/A";
        lotAreaValues.Add(lotArea);

        string lotFront;
        lotFront = feature["properties"]["LotFront"].ToString() ?? "N/A";
        lotFrontValues.Add(lotFront);

        string lotDepth;
        lotDepth = feature["properties"]["LotDepth"].ToString() ?? "N/A";
        lotDepthValues.Add(lotDepth);
        
        string builtFAR;
        builtFAR = feature["properties"]["BuiltFAR"].ToString() ?? "N/A";
        builtFARValues.Add(builtFAR);



        // Process only MultiPolygon geometries
        if (geometryType == "MultiPolygon")
        {
          JArray multiPolygonCoordinates = (JArray) feature["geometry"]["coordinates"];

          // Iterate through each polygon in the MultiPolygon
          foreach (JArray polygonCoordinates in multiPolygonCoordinates)
          {
            // Each polygon may have multiple rings (outer ring + inner rings)
            foreach (JArray ringCoordinates in polygonCoordinates)
            {
              List<Point3d> points = new List<Point3d>();

              // Iterate over each coordinate pair in the ring
              foreach (JArray coord in ringCoordinates)
              {
                double x = (double) coord[0];
                double y = (double) coord[1];
                points.Add(new Point3d(x, y, 0));
              }

              // Close the polyline if it's not closed
              if (points.Count > 0 && !points[0].Equals(points[points.Count - 1]))
              {
                points.Add(points[0]);
              }

              // Create and add polyline
              polylines.Add(new Polyline(points));
            }
          }
        }
      }
    }
    catch (Exception ex)
    {
      Print("Error reading or parsing GeoJSON: " + ex.Message);
    }

    // Set output
    PL = polylines;
    Zone = zoneDist1Values;
    Block = blockValues;
    Lot = lotValues;
    Address = addressValues;
    LandUse = landUseValues;
    LotArea = lotAreaValues;
    LotFront = lotFrontValues;
    LotDepth = lotDepthValues;
    BuiltFAR = builtFARValues;
# ---------- end c_script ----------
item = ListItem(List=c_script.PL, Index=number_slider, Wrap=True)
item_2 = ListItem(List=c_script.Zone, Index=number_slider, Wrap=True)
item_3 = ListItem(List=c_script.Block, Index=number_slider, Wrap=True)
item_4 = ListItem(List=c_script.Lot, Index=number_slider, Wrap=True)
item_5 = ListItem(List=c_script.Address, Index=number_slider, Wrap=True)
item_6 = ListItem(List=c_script.LotArea, Index=number_slider, Wrap=True)
item_7 = ListItem(List=c_script.LandUse, Index=number_slider, Wrap=True)
item_8 = ListItem(List=c_script.LotFront, Index=number_slider, Wrap=True)
item_9 = ListItem(List=c_script.LotDepth, Index=number_slider, Wrap=True)
item_10 = ListItem(List=c_script.BuiltFAR, Index=number_slider, Wrap=True)
address = Panel(item_5)
land_use = Panel(item_7)
lot = Panel(item_4)
panel_2 = Panel(item)
zone = Panel(item_2)
block = Panel(item_3)
lot_area = Panel(item_6)
lot_front = Panel(item_8)
lot_depth = Panel(item_9)
built_far = Panel(item_10)
panel_3 = Panel("""One & Two Family Buildings
Multi-Family Walk-Up Buildings
Multi-Family Elevator Buildings
Mixed Residential & Commercial Buildings
Commercial & Office Buildings
Industrial & Manufacturing
Transportation & Utility
Public Facilities & Institutions
Open Space & Outdoor Recreation
Parking Facilities
Vacant Land""")
panel_4 = Panel("""01
02
03
04
05
06
07
08
09
10
11""")
keysearch = KeyValueSearch(Keys=panel_4, Values=panel_3, Search=land_use)
land_use_2 = Panel(keysearch)
