# Grasshopper definition geoJson parser-BuildingFootPrint.gh (Grasshopper 1.0.7)
# plug-ins: Wombat

path = FilePath("C:\Users\eertugrul\Downloads\Buildings.geojson")
c_script = CSharpScript(FilePath=path, Reference="C:\Program Files\ShapeDiver\ShapeDiverGhPlugins\Newtonsoft.Json.dll")  # -> out, PL, height; inputs FilePath: String
# ---------- c_script: C# usings ----------
using Newtonsoft.Json;
using Newtonsoft.Json.Linq;
using System.IO;
# ---------- c_script: C# ----------
    List<Polyline> polylines = new List<Polyline>();
    List<string> heightValues = new List<string>();


    try
    {
      // Read the GeoJSON file
      string geoJsonString = File.ReadAllText(FilePath);

      // Parse the GeoJSON using Newtonsoft.Json
      JObject geoJson = JObject.Parse(geoJsonString);
      JArray features = (JArray) geoJson["features"];

      foreach (JObject feature in features)
      {
        string geometryType = feature["geometry"]["type"].ToString();





        // Process only MultiPolygon geometries
        if (geometryType == "MultiPolygon")
        {
          JArray multiPolygonCoordinates = (JArray) feature["geometry"]["coordinates"];

          // Iterate through each polygon in the MultiPolygon
          foreach (JArray polygonCoordinates in multiPolygonCoordinates)
          {
            // Each polygon may have multiple rings (outer ring + inner rings)
            foreach (JArray ringCoordinates in polygonCoordinates)
            {
              List<Point3d> points = new List<Point3d>();

              // Iterate over each coordinate pair in the ring
              foreach (JArray coord in ringCoordinates)
              {
                double x = (double) coord[0];
                double y = (double) coord[1];
                points.Add(new Point3d(x, y, 0));
              }

              // Close the polyline if it's not closed
              if (points.Count > 0 && !points[0].Equals(points[points.Count - 1]))
              {
                points.Add(points[0]);
              }

              // Create and add polyline
              polylines.Add(new Polyline(points));

              // Retrieve ZoneDist1 from properties if it exists
              string heightRoof;
              if(feature["properties"]["heightroof"] != null){
                heightRoof = feature["properties"]["heightroof"].ToString();
              }
              else { heightRoof = "0";}


              heightValues.Add(heightRoof);
            }
          }
        }
      }
    }
    catch (Exception ex)
    {
      Print("Error reading or parsing GeoJSON: " + ex.Message);
    }

    // Set output
    PL = polylines;
    height = heightValues;
# ---------- end c_script ----------
number_slider = Slider(430, range=0..1000)
panel = Panel(c_script.height)
panel_2 = Panel(c_script.PL)
item = ListItem(List=c_script.PL, Index=number_slider, Wrap=True)
item_2 = ListItem(List=c_script.height, Index=number_slider, Wrap=True)
vec = VectorXYZ(XComponent=0, YComponent=0, ZComponent=c_script.height)  # -> Vector, Length
area = Area(Geometry=item)  # -> Area, Centroid
extrudem = ExtrudeAsMesh(Polyline=c_script.PL, Direction=vec.Vector, Cap=Toggle(True))
